# Grasshopper definition TestingDesignKitHolz.gh (Grasshopper 1.0.8)

number_slider = Slider(3.8, range=0..10)
number_slider_2 = Slider(200, range=0..1000)
bolt_t_s = CSharpScript(
    diameter=Slider(8, range=0..10),
    fuk="390",
    timber="C24",
    t1=Slider(50, range=0..100),
    theta1=Slider(90, range=0..90),
    t_steel=Slider(6, range=0..10))  # -> out, capacity_total, failuremode, capacities_plane, failuremodes, spacings; inputs diameter: Double, fuk: Double, timber: String, t1: Double, theta1: Double, t_steel: Double
# ---------- bolt_t_s: C# ----------
// Grasshopper Script Instance
#region Usings
using System;
#r "C:\Users\jjs\Documents\Github\StructuralDesignKit_Timber\GrasshopperDemo\StructuralDesignKitLibrary_FormatProposals.dll"
using System.Linq;
using System.Collections;
using System.Collections.Generic;
using System.Drawing;

using Rhino;
using Rhino.Geometry;

using Grasshopper;
using Grasshopper.Kernel;
using Grasshopper.Kernel.Data;
using Grasshopper.Kernel.Types;

using Conns = StructuralDesignKitLibrary.Connections;
using EC5 = StructuralDesignKitLibrary.EC5;
using Materials = StructuralDesignKitLibrary.Materials;

#endregion

public class Script_Instance : GH_ScriptInstance
{
    #region Notes
    /* 
      Members:
        RhinoDoc RhinoDocument
        GH_Document GrasshopperDocument
        IGH_Component Component
        int Iteration

      Methods (Virtual & overridable):
        Print(string text)
        Print(string format, params object[] args)
        Reflect(object obj)
        Reflect(object obj, string method_name)
    */
    #endregion

    private void RunScript(
		double diameter,
		double fuk,
		string timber,
		double t1,
		double theta1,
		double t_steel,
		ref object capacity_total,
		ref object failuremode,
		ref object capacities_plane,
		ref object failuremodes,
		ref object spacings)
    {
        // Write your logic here
        Conns.Interface.IFastener bolt = new Conns.Fasteners.FastenerBolt(diameter,fuk);
        Materials.MaterialTimberSoftwood wood = new Materials.MaterialTimberSoftwood(timber);
        var conn = new Conns.SteelTimberShear.SingleOuterSteelPlate(bolt,t_steel,theta1,wood,t1,true);
        capacity_total = conn.Capacity;
        capacities_plane = conn.Capacities;
        failuremode = conn.FailureMode;
        failuremodes = conn.FailureModes;

        bolt.ComputeSpacings(theta1,null);
        List<string> spacingData = new List<string>();
        spacingData.Add("a1min = " + conn.Fastener.a1min);
        spacingData.Add("a2min = " + conn.Fastener.a2min);
        spacingData.Add("a3tmin = " + conn.Fastener.a3tmin);
        spacingData.Add("a3cmin = " + conn.Fastener.a3cmin);
        spacingData.Add("a4tmin = " + conn.Fastener.a4tmin);
        spacingData.Add("a4cmin = " + conn.Fastener.a4cmin);
        spacings = spacingData;

    }
}
# ---------- end bolt_t_s ----------
timber_rect_column = CSharpScript(
    b=number_slider_2,
    h=number_slider_2,
    timber="C16",
    serviceClass="SC1",
    loadDuration="Permanent",
    Fx="150",
    My=Slider(0, range=0..1),
    Mz=Slider(0, range=0..1),
    ley=number_slider,
    lez=number_slider)  # -> out, results; inputs b: Int32, h: Int32, timber: String, serviceClass: String, loadDuration: String, Fx: Double, My: Double, Mz: Double, ley: Double, lez: Double
# ---------- timber_rect_column: C# ----------
// Grasshopper Script Instance
#region Usings
using System;
#r "C:\Users\jjs\Documents\Github\StructuralDesignKit_Timber\GrasshopperDemo\StructuralDesignKitLibrary_FormatProposals.dll"
using System.Linq;
using System.Collections;
using System.Collections.Generic;
using System.Drawing;

using Rhino;
using Rhino.Geometry;

using Grasshopper;
using Grasshopper.Kernel;
using Grasshopper.Kernel.Data;
using Grasshopper.Kernel.Types;

using Conns = StructuralDesignKitLibrary.Connections;
using EC5 = StructuralDesignKitLibrary.EC5;
using Materials = StructuralDesignKitLibrary.Materials;
using CrossSections = StructuralDesignKitLibrary.CrossSections;
using Utilities = StructuralDesignKitLibrary.EC5.EC5_Utilities;

#endregion

public class Script_Instance : GH_ScriptInstance
{
    #region Notes
    /* 
      Members:
        RhinoDoc RhinoDocument
        GH_Document GrasshopperDocument
        IGH_Component Component
        int Iteration

      Methods (Virtual & overridable):
        Print(string text)
        Print(string format, params object[] args)
        Reflect(object obj)
        Reflect(object obj, string method_name)
    */
    #endregion

    private void RunScript(
		int b,
		int h,
		string timber,
		string serviceClass,
		string loadDuration,
		double Fx,
		double My,
		double Mz,
		double ley,
		double lez,
		ref object results)
    {
        // Write your logic here
        Materials.IMaterialTimber wood;

        if(timber.ToCharArray()[0]=='C') wood = new Materials.MaterialTimberSoftwood(timber);
        else wood = new Materials.MaterialTimberHardwood(timber);

        CrossSections.CrossSectionRectangular csr = new CrossSections.CrossSectionRectangular(b,h,wood);
        
        EC5.EC5_Utilities.ServiceClass sClass;
        Enum.TryParse(serviceClass,out sClass);
        
        EC5.EC5_Utilities.LoadDuration dur;
        Enum.TryParse(loadDuration,out dur);

        double kmod = EC5.EC5_Factors.Kmod(wood.Type,sClass,dur);
        double gamma_M = EC5.EC5_Factors.Ym(wood.Type);

        double sig0 = csr.ComputeNormalStress(Fx);
        Print("sig0="+sig0);
        //Clause 6.1.4 - Compression Parallel to Grain
        double check1 = EC5.EC5_CrossSectionCheck.CompressionParallelToGrain(sig0,wood,kmod,gamma_M,false);

        //Clause 6.3.2 - Compression or Compression + Bending
        double sig_myd = csr.ComputeStressBendingY(My);
        double sig_mzd = csr.ComputeStressBendingZ(Mz);
        double check2 = EC5.EC5_CrossSectionCheck.BendingAndBuckling(sig_myd,sig_mzd,sig0,ley,lez,csr,wood,kmod,gamma_M);

        // //check under fire:
        // CrossSections.CrossSectionRectangular fireSection = csr.ComputeReducedCrossSection(30,true,true,true,true);
        // double sig0_fi = fireSection.ComputeNormalStress(110);
        // double sig_myd_fi = fireSection.ComputeStressBendingY(My);
        // double sig_mzd_fi = fireSection.ComputeStressBendingZ(Mz);
        // Print("B="+fireSection.B);
        // double check3 = EC5.EC5_CrossSectionCheck.BendingAndBuckling(sig_myd_fi,sig_mzd_fi,sig0_fi,ley,lez,fireSection,wood,kmod,gamma_M,1,1,true);

        // Print("Kfi="+EC5.EC5_Factors.Kfi(wood));
        // Print("Kc="+EC5.EC5_Factors.Kc(fireSection, wood, ley, lez, true)[0]);

        results = new List<double>(){check1,check2};
    }
}
# ---------- end timber_rect_column ----------
bolt = CSharpScript(diameter=Slider(6, range=0..10), fuk="390")  # -> out, spacings; inputs diameter: Double, fuk: Double
# ---------- bolt: C# ----------
// Grasshopper Script Instance
#region Usings
using System;
#r "C:\Users\jjs\Documents\Github\StructuralDesignKit_Timber\GrasshopperDemo\StructuralDesignKitLibrary_FormatProposals.dll"
using System.Linq;
using System.Collections;
using System.Collections.Generic;
using System.Drawing;

using Rhino;
using Rhino.Geometry;

using Grasshopper;
using Grasshopper.Kernel;
using Grasshopper.Kernel.Data;
using Grasshopper.Kernel.Types;

using Conns = StructuralDesignKitLibrary.Connections;
using EC5 = StructuralDesignKitLibrary.EC5;
using Materials = StructuralDesignKitLibrary.Materials;

#endregion

public class Script_Instance : GH_ScriptInstance
{
    #region Notes
    /* 
      Members:
        RhinoDoc RhinoDocument
        GH_Document GrasshopperDocument
        IGH_Component Component
        int Iteration

      Methods (Virtual & overridable):
        Print(string text)
        Print(string format, params object[] args)
        Reflect(object obj)
        Reflect(object obj, string method_name)
    */
    #endregion

    private void RunScript(double diameter, double fuk, ref object spacings)
    {
        // Write your logic here
        Conns.Interface.IFastener bolt = new Conns.Fasteners.FastenerBolt(diameter,fuk);

        bolt.ComputeSpacings(null,null);
        List<string> spacingData = new List<string>();
        spacingData.Add("a1min = " + bolt.a1min);
        spacingData.Add("a2min = " + bolt.a2min);
        spacingData.Add("a3tmin = " + bolt.a3tmin);
        spacingData.Add("a3cmin = " + bolt.a3cmin);
        spacingData.Add("a4tmin = " + bolt.a4tmin);
        spacingData.Add("a4cmin = " + bolt.a4cmin);
        spacings = spacingData;

    }
}
# ---------- end bolt ----------
panel = Panel(bolt.spacings)
panel_2 = Panel(bolt_t_s.capacity_total)
panel_3 = Panel(bolt_t_s.failuremode)
panel_4 = Panel(bolt_t_s.capacities_plane)
varies_with_theta = Panel(bolt_t_s.spacings)
panel_5 = Panel(timber_rect_column.results)
panel_6 = Panel(bolt_t_s.failuremodes)
